# Grasshopper definition indoor_airflow.gh (Grasshopper 0.9.76)
# plug-ins: Python Interpreter

# ---- group: I don't know what to call these
epsilonwallfunction = Butterfly_epsilonWallFunction(Cmu=0.09, kappa=0.4, E=9.8)  # -> epsilonWallFunction; plug-in component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
nutkwallfunction = Butterfly_nutkW4allFunction()  # -> nutkWallFunction; plug-in component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
kqrwallfunction = Butterfly_kqRWallFunction(value="0.01")  # -> kqRWallFunction; plug-in component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
fixedvalue = Butterfly_fixedValue(value="(0 0 0)")  # -> fixedValue; plug-in component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
calculated = Butterfly_calculated()  # -> calculated; plug-in component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
zerogradient = Butterfly_zeroGradient()  # -> zeroGradient; plug-in component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

# ----
# Create your own boundary
# from boundary conditions
panel = Panel("patch")

# ---- group: create your own
boundary = Butterfly_Boundary(bType=panel, U=zerogradient, p=zerogradient, k=zerogradient, epsilon=calculated, nut=calculated)  # -> readMe, boundary; plug-in component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

# ----
# 0. Create BF surfaces
panel_2 = Panel("2")
vec = VectorXYZ(XComponent=panel_2, YComponent=0, ZComponent=0)  # -> Vector, Length
inlet = Butterfly_InletBoundary(velocityVec=vec.Vector, refLevels="(5, 5)")  # -> inletBoundary; plug-in component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
outlet = Butterfly_OutletBoundary(refLevels="(5, 5)")  # -> outletBoundary; plug-in component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
wall = Butterfly_WallBoundary(refLevels="(1, 5)")  # -> wallBoundary; plug-in component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

# ---- group: walls
brep = Brep(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)

# ---- group: inlet!
# Indoor Study
srf = Surface(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)

# ---- group: outlet
srf_2 = Surface(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)

# ----
number_slider = Slider(10, range=0..10)
wires = BrepWireframe(Brep=brep, Density=-1)
area = Area(Geometry=srf)  # -> Area, Centroid
jagged = SettingsSpeed()
vdis = VectorDisplay(Anchor=area.Centroid, Vector=vec.Vector)
preview = CustomPreview(Geometry=[srf_2, srf], Shader=ColourSwatch(SwatchColor=RGBA(136, 191, 255, 77)))
box = DomainBox(Base=PlaneXY(0, 0, 0), X=number_slider, Y=number_slider, Z=number_slider)
wires_2 = BrepWireframe(Brep=box, Density=-1)
createbfsurface = Butterfly_CreateButterflySurface(geo=srf, name="west_window", boundary=inlet, meshSet=jagged)  # -> readMe, BFSrf; plug-in component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
createbfsurface_2 = Butterfly_CreateButterflySurface(geo=brep, name="room", boundary=wall, meshSet=jagged)  # -> readMe, BFSrf; plug-in component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
createbfsurface_3 = Butterfly_CreateButterflySurface(geo=srf_2, name="east_window", boundary=outlet, meshSet=jagged)  # -> readMe, BFSrf; plug-in component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
preview_2 = CustomPreview(
    Geometry=wires_2,
    Shader={ambient=RGB(0, 0, 0), diffuse=RGB(255, 105, 180), emission=RGB(76, 32, 54), shine=0.5, specular=RGB(255, 255, 255), transparency=0})
blockmeshdict = Butterfly_blockMeshDict(bbox=box, nDivXYZ="{2,2,2}", gradXYZ="{1,1,1}")  # -> blockMeshDict; plug-in component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
dom = ConstructDomain(DomainStart="1", DomainEnd="2")

# ---- group: Create and write the case!
# 1. Create the OpenFOAM case
createcasefromsurfaces = Butterfly_CreateCaseFromSurfaces(
    name="indoor_airflow_0",
    BFSurfaces=flatten([createbfsurface.BFSrf, createbfsurface_2.BFSrf, createbfsurface_3.BFSrf]),
    blockMeshDict=blockmeshdict,
    globalRefLevel=dom,
    run=Toggle(False))  # -> readMe, case; plug-in component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

# ----
panel_3 = Panel(createcasefromsurfaces.readMe)
# purgeCase
purgecase = Butterfly_purgeCase(blockMesh=False, snappyHexMesh=False, results=False)  # -> readMe; plug-in component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
brep_2 = Brep([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])
gentestpts = Honeybee_GenerateTestPoints(testGeometry=brep_2, gridSize=Slider(0.5, range=0..1), distBaseSrf="0.05", moveTestMesh=Toggle(False))  # -> readMe, simplify(testPoints), simplify(ptsVectors), simplify(facesArea), simplify(mesh); plug-in component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
flatten = FlattenTree(Tree=gentestpts.testPoints, Path="{0}")

# ----
# 0. blockMesh
# 1. snappyHexMesh
# 2. simpleFOAM
# This will eventually change to a recipe,
toggle = BooleanToggle(True)
snappyhexmeshdict = Butterfly_snappyHexMeshDict(castellatedMesh=True, snap=True, addLayers=False, maxGlobalCells=2000000)  # -> snappyHexMeshDict; plug-in component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
blockmesh = Butterfly_blockMesh(case=createcasefromsurfaces.case, purge=toggle, run=Toggle(False))  # -> readMe, case; plug-in component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
snappyhexmesh = Butterfly_snappyHexMesh(case=blockmesh.case, snappyHexMeshDict=snappyhexmeshdict, run=Toggle(False))  # -> out, case; plug-in component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
panel_4 = Panel("""U
p""")
controldict = Butterfly_controlDict(startTime=0, endTime=1000, writeInterval=100, writeCompression=False)  # -> controlDict; plug-in component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
residualcontrol = Butterfly_residualControl(p="0.0001", U="0.0001", k="0.0001", epsilon="0.0001")  # -> residualControl; plug-in component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
probes = Butterfly_probes(pts=flatten, fields=panel_4)  # -> probes; plug-in component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

# ----
# 1.1. checkMesh
chekmesh = Butterfly_chekMesh(case=snappyhexmesh.case, run=Toggle(False))  # -> readMe, case, maxNonOrthogonality; plug-in component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
# Mesh and run the case
panel_5 = Panel(chekmesh.readMe)
# 1.2. update fvScheme based on
# mesh orthogonality
updatefvschemes = Butterfly_UpdateFvSchemes(case=chekmesh.case, orthogonality=chekmesh.maxNonOrthogonality, run=Toggle(False))  # -> readMe, case; plug-in component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

# ---- group: case
data = Data(snappyhexmesh.case)

# ----
# Load mesh/points
toggle_2 = BooleanToggle(False)
loadmesh = Butterfly_LoadMesh(case=data, load=toggle_2)  # -> mesh; plug-in component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
loadpoints = Butterfly_LoadPoints(case=data, load=Toggle(False))  # -> pts; plug-in component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

# ---- group: execute the case - simpleFoam for now
simplefoam = Butterfly_simpleFoam(case=updatefvschemes.case, controlDict=controldict, residualControl=residualcontrol, probes=probes, run=Toggle(False))  # -> readMe, case; plug-in component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

# ----
data_2 = Data(simplefoam.case)
loadprobes = Butterfly_LoadProbes(case=data_2, field="p")  # -> skippedPoints, values; plug-in component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
loadprobes_2 = Butterfly_LoadProbes(case=data_2, field="U")  # -> skippedPoints, values; plug-in component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
# Results visualization
panel_6 = Panel(loadprobes.skippedPoints)

# ---- group: vectors
vec_2 = Vector(loadprobes_2.values)

# ---- group: points
pt = Point(flatten)

# ----
vlen = VectorLength(Vector=vec_2)
bnd = Bounds(Numbers=vlen)
scale = Slider(0.27, range=0..1)
remap = RemapNumbers(Value=vlen, Source=bnd, Target=Domain(1, 0))  # -> Mapped, Clipped
gradient = Gradient(
    LowerLimit=0,
    UpperLimit=1,
    Parameter=remap.Mapped,
    stops=[0: RGB(234, 38, 0), 0.25: RGB(234, 126, 0), 0.5: RGB(254, 244, 84), 0.75: RGB(173, 203, 249), 1: RGB(75, 107, 169)])
multiplication = Multiplication(A=vec_2, B=scale)
vdisex = VectorDisplayEx(Point=pt, Vector=multiplication, Colour=gradient, Width=Slider(2, range=0..5))

flatten_2 = FlattenTree(Tree=gentestpts.mesh, Path="{0}")
mjoin = MeshJoin(Meshes=flatten_2)
ladybug = Ladybug_Ladybug()  # -> Vviiiiiiiiiizzz; plug-in component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
recolormesh = Ladybug_RecolorMesh(analysisResult=loadprobes.values, inputMesh=mjoin, analysisTitle="pressure", legendTitle="Pa")  # -> readMe, newMesh, newLegend, legendBasePt, meshColors, legendColors; plug-in component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
